# Dynamo graph Home.dyn (Dynamo 1.3.2.2480)

select_model_element = DSModelElementSelection()  # 1 picked in the model
curve = CurveElement.Curve(select_model_element)
code_block = CodeBlock { 1000; }
translate = Geometry.Translate(geometry=curve, xTranslation=code_block)
byCurve = ModelCurve.ByCurve(translate)
code_block_2 = CodeBlock { 2000; }
translate_2 = Geometry.Translate(geometry=curve, xTranslation=code_block)
code_block_3 = CodeBlock { "Line Style"; }
line_styles = LineStyleUi("RedLine")
setParameterByName = Element.SetParameterByName(element=translate_2, parameterName=code_block_3, value=line_styles)
watch = Watch(setParameterByName)
byCurve_2 = ModelCurve.ByCurve(translate_2)
